# Dynamo graph Dynamo 1.3 - 1 - First request.dyn (Dynamo 1.3.1.1736)

# group: 1. Input
# note: All web requests start with a web address, also known as a URL.
# This is what you typically type into the address bar of your web browser.
string = StringInput("http://www.google.com/")

# group: 2. DynaWeb : Build & Execute simple request
# note: The "WebRequest.ByURL" node in the DynaWeb Dynamo library builds a web request to the URL provided.
byUrl = DynaWeb.WebRequest.ByUrl(string)
# note: The "WebRequest.Execute" node in the DynaWeb Dynamo library simply executes the web request it is given. It returns a WebResponse object.
execute = DynaWeb.WebRequest.Execute(byUrl)

# group: 3. Response
# note: The WebResponse.Content node returns the actual content returned from the server.
# In this example, it's the HTML content returned by the Google.com address. A brower would take this HTML markup and represent it graphically as a webpage.
content = DynaWeb.WebResponse.Content(execute)
watch = Watch(content)
