# Dynamo graph Dynamo 1.3 - 7 - Upload file to Autodesk Forge.dyn (Dynamo 1.3.1.1736)

# group: Upload file to Autodesk Forge
# note: This sample uploads a file to an existing Autodesk Forge bucket.

# group: INPUT
bucket_key_here = StringInput("radubucket")
# note: Note : the bucket has to exist already.
file_name_here = StringInput("pingfile.txt")
token_here_without_bearer = StringInput("xxxxxxxxxxxxxxxxxxxxxxxxxxxxxxxxxxxxxxxxxxxxxxxxxxxxxxxxxxxxxxxxxxxxxxxxxxxxxxxxxxxxxxxxxxxxxxxxxxxxxxxxxxxxxxxxxxxxxxxxxxxxxxxxxxxxxxxxxxxxxxxxxxxxxxxxxxxxxxxxxxxxxxxxxxxxxxxxxxxxxxxxxxxxxxxxxxxxxxxxxxxxxxxxxxxxxxxxxxxxxxxxxxxxxxxxxxxxxxxxxxxxxxxxxxxxxxxxxxxxxxxxxxxxxxxxxxxxxxxxxxxxxxxxxxxxxxxxxxxxxxxxxxxxxxxxxxxxxxxxxxxxxxxxxxxxxxxxxx")
# note: Notes :
# - replace with your own token
# - token requires the "data:write" scope
file_path = Filename("C:\Users\radug\Desktop\ping.txt")

# group: Build URL
string = StringInput("https://developer.api.autodesk.com/oss/v2/buckets/")
string_2 = StringInput("/objects/")
code_block = CodeBlock(urlbase=string, bucketname=bucket_key_here, object=string_2, filename=file_name_here)
# ---------- code_block.designscript (4 lines) ----------
urlbase+
bucketname+
object+
filename;
# ----------------------------------------

# group: Build POST Request
byUrl = DynaWeb.WebRequest.ByUrl(code_block)
string_3 = StringInput("PUT")
setMethod = DynaWeb.WebRequest.SetMethod(byUrl, string_3)

# group: Auth credentials
string_4 = StringInput("Authorization")
code_block_2 = CodeBlock(tokern=token_here_without_bearer)
# ---------- code_block_2.designscript (2 lines) ----------
"Bearer "+
tokern;
# ----------------------------------------
addHeader = DynaWeb.WebRequest.AddHeader(setMethod, string_4, code_block_2)

# group: Content type
string_5 = StringInput("Content-Type")
string_6 = StringInput("application/octet-stream")
addHeader_2 = DynaWeb.WebRequest.AddHeader(addHeader, string_5, string_6)

# group: Add file
string_7 = StringInput("filename")
code_block_3 = CodeBlock(filepath=file_path) { filepath; }
addFileAsBytes = DynaWeb.WebRequest.AddFileAsBytes(addHeader_2, string_7, string_7, code_block_3)

# group: Execute
execute = DynaWeb.WebRequest.Execute(addFileAsBytes)
statusCode = DynaWeb.WebResponse.StatusCode(execute)
content = DynaWeb.WebResponse.Content(execute)

# group: Deserialise JSON
deserialiseAsDictionary = DynaWeb.Helpers.DeserialiseAsDictionary(content)
watch = Watch(deserialiseAsDictionary.out0)
watch_2 = Watch(deserialiseAsDictionary.out1)
