# Dynamo graph Dynamo 2.0 - 2 - Simple request.dyn

# group: 2. Executing the request
# note: The next step is to retrieve the page/data from the web address. This process is known as executing a web request.
# To do this, a few steps are followed :
# - a web request is built from the URL provided
# - the request is executed
# - the server that powers the website you're requesting from provides a Response
# - the request we built returns the Response
# note: The next step is to retrieve the page/data from the web address, a process known as executing a web request.
# Web requests can be executed with a few different methods, with the 2 most used being  :
# - GET : this gets data from the server
# - POST : this sends data to the server
# For example, to a web page, your browser sends a GET request to the address you're trying to view. On the other hand, when you're submitting a form (such as logging in to a site, or posting something on Twitter), your browser most likely sends a POST request to the URL address.

# group: 3. Response from server
# note: Once a request is sent to a server will send back a response. A short description of this process is :
# - request is received by server
# - server processes the request, gathering all the data needed
# - the server sends back this data to the requester
# - the request is completed and the data returned from the server is made available as the Response.
# note: Responses from servers can come in many different shapes and sizes and also have some meta-data associated, such as :
# - response status code
# - headers, cookies & etc
# Have you ever tried to load a website only to be greeted by a 404 Error? That's the response status code returned by the server and each number has a different meaning :
# - 200 : all ok
# - 404 : can't find what you requested
# - 503 : the server could not return your data due to an internal fault
# There's many more codes, see this wiki :
# https://en.wikipedia.org/wiki/List_of_HTTP_status_codes

# group: 1. Input
# note: All web requests start with a web address, also known as a URL.
# This is what you typically type into the address bar of your web browser.
string = StringInput("http://www.google.com/")
# note: I suggest using something like JsonPlaceholder to test out the package and web responses.
# https://jsonplaceholder.typicode.com
# Visit the site to generate a fresh URL, this one will likely be out of date.
string_2 = StringInput("https://jsonplaceholder.typicode.com/users/1")

# group: DynaWeb : Build & Execute simple request
# note: The "WebRequest.ByURL" node in the DynaWeb Dynamo library builds a web request to the URL provided.
# This node also defaults to building a GET request, but this can be overriden after the request is built using the "WebRequest.SetMethod" node, see the more advanced samples.
byUrl = DynaWeb.WebRequest.ByUrl(url=string, lacing=Shortest)
# note: The "WebRequest.Execute" node in the DynaWeb Dynamo library simply executes the web request it is given. It expects a valid WebRequest as input.
execute = DynaWeb.WebRequest.Execute(request=byUrl, lacing=Shortest)

# group: Response
# note: The Execute node from the DynaWeb package returns a WebResponse object. This object contains all the metadata of the response as well as the content itself.
# The WebResponse.Content node returns the actual content returned from the server.
# In this example, it's the HTML content of the page requested. A brower would take this HTML markup and represent it graphically as a webpage.
content = DynaWeb.WebResponse.Content(webResponse=execute, lacing=Shortest)
watch = Watch(content)

# group: DynaWeb : Build & Execute simple request
byUrl_2 = DynaWeb.WebRequest.ByUrl(url=string_2, lacing=Shortest)
execute_2 = DynaWeb.WebRequest.Execute(request=byUrl_2, lacing=Shortest)

# group: Response
# note: In this example, the server does not return HTML to us, but a simple key/value encoded as JSON.
# This type of response is returned by web services, APIs, etc and is intended to be converted into usable values by whoever made the request. The process of converting this text to actual values is known as Deserialising.
content_2 = DynaWeb.WebResponse.Content(webResponse=execute_2, lacing=Shortest)
watch_2 = Watch(content_2)

# group: Dynamo core node
# note: The "Web Request" node in the Core Dynamo library :
# - builds a web request to the URL provided
# - executes it as well.
# The node always builds a GET request.
web_request = WebRequest(url=string)

# group: Response
# note: The "Web Request" node from the Core Dynamo library returns the content of the web response by default and none of the metadata.
# This means the response does not need to be unwrapped using a Response node and can be plugged straight into any other node, such as a Watch.
watch_3 = Watch(web_request)
