# Dynamo graph Dynamo 2.0 - 3 - Simple request with benchmarking.dyn

# group: 2. Executing the request
# note: The next step is to retrieve the page/data from the web address. This process is known as executing a web request.
# To do this, a few steps are followed :
# - a web request is built from the URL provided
# - the request is executed
# - the server that powers the website you're requesting from provides a Response
# - the request we built returns the Response
# note: The next step is to retrieve the page/data from the web address, a process known as executing a web request.
# Web requests can be executed with a few different methods, with the 2 most used being  :
# - GET : this gets data from the server
# - POST : this sends data to the server
# For example, to view a web page, your browser sends a GET request to the address you're trying to view. On the other hand, when you're submitting a form (such as logging in to a site, or posting something on Twitter), your browser most likely sends a POST request to the URL address.

# group: 3. Response from server
# note: Once a request is sent to a server, it will send back a response. A short description of this process is :
# - request is received by server
# - server processes the request, gathering all the data needed
# - the server sends back this data to the requester
# - the request is completed and the data returned from the server is made available as the Response.
# note: Responses from servers can come in many different shapes and sizes and also have some meta-data associated, such as :
# - response status code
# - headers, cookies & etc
# Have you ever tried to load a website only to be greeted by a 404 Error? That's the response status code returned by the server and each number has a different meaning :
# - 200 : all ok
# - 404 : can't find what you requested
# - 503 : the server could not return your data due to an internal fault
# There's many more codes, see this wiki :
# https://en.wikipedia.org/wiki/List_of_HTTP_status_codes

# group: 1. Input
# note: I suggest using something like JsonPlaceholder to test out the package and web responses.
# https://jsonplaceholder.typicode.com
# Visit the site to generate a fresh URL, this one will likely be out of date.
# note: All web requests start with a web address, also known as a URL.
# This is what you typically type into the address bar of your web browser.
string = StringInput("https://jsonplaceholder.typicode.com/users/1")

# group: Dynamo core node
# note: The "Web Request" node in the Core Dynamo library :
# - builds a web request to the URL provided
# - executes it as well.
# The node always executes a GET request.
web_request = WebRequest(url=string)

# group: Response
# note: The "Web Request" node from the Core Dynamo library returns the content of the web response by default and none of the metadata.
# This means the response does not need to be unwrapped using a Response node and can be plugged straight into any other node, such as a Watch.
watch = Watch(web_request)

# group: DynaWeb : Build & Execute simple request
# note: The "WebRequest.ByURL" node in the DynaWeb Dynamo library builds a web request to the URL provided.
# This node also defaults to building a GET request, but this can be overriden after the request is built using the "WebRequest.SetMethod" node, see the more advanced samples.
byUrl = Web.WebRequest.ByUrl(url=string, lacing=Shortest)
# note: The "WebRequest.Execute" node in the DynaWeb Dynamo library simply executes the web request it is given. It expects a valid WebRequest as input.
execute = Web.WebRequest.Execute(request=byUrl, lacing=Shortest)

# group: Response
# note: The Execute node from the DynaWeb package returns a WebResponse object. This object contains all the metadata of the response as well as the content itself.
# The WebResponse.Content node returns the actual content returned from the server. Try adding another query node (marked with ?) from the WebResponse part of the library.
# In this example, it's the HTML content of the page requested. A brower would take this HTML markup and represent it graphically as a webpage.
# In this example, the server does not return HTML to us, but a custom "user" object encoded as JSON.
# This type of response is returned by web services, APIs, etc and is intended to be converted into usable values by whoever made the request. The process of converting this text to actual values is known as Deserialising, which is demonstrated in the REST API sample.
content = Web.WebResponse.Content(webResponse=execute, lacing=Shortest)
watch_2 = Watch(content)

# group: 4. Output to files
# note: Output the content of the web responses to disk.
# The responses from the Dynamo Core node and the DynaWeb library are saved separately, so you can benchmark the potential difference between them.
directory_path = Directory("C:\Users\radug\Desktop\testing")
code_block = CodeBlock { "Response-DynamoCore.txt"; "Response-DynaWeb.txt"; }
combinePath = File.CombinePath(path0=directory_path, path1=code_block.out0, lacing=Shortest)
writeText = File.WriteText(filePath=combinePath, text=watch, lacing=Shortest)
combinePath_2 = File.CombinePath(path0=directory_path, path1=code_block.out1, lacing=Shortest)
writeText_2 = File.WriteText(filePath=combinePath_2, text=watch_2, lacing=Shortest)

# group: Response metadata
content_2 = Web.WebResponse.Content(webResponse=execute, lacing=Shortest)
watch_3 = Watch(content_2)
statusCode = Web.WebResponse.StatusCode(webResponse=execute, lacing=Shortest)
statusDescription = Web.WebResponse.StatusDescription(webResponse=execute, lacing=Shortest)
responseStatus = Web.WebResponse.ResponseStatus(webResponse=execute, lacing=Shortest)
responseUri = Web.WebResponse.ResponseUri(webResponse=execute, lacing=Shortest)
server = Web.WebResponse.Server(webResponse=execute, lacing=Shortest)
cookies = Web.WebResponse.Cookies(webResponse=execute, lacing=Shortest)
headers = Web.WebResponse.Headers(webResponse=execute, lacing=Shortest)
watch_4 = Watch(headers)

# group: Time it took for Request to execute
# note: The built-in nodes do not offer any metadata for the request or response, such as timing.
# If you would like to time both the Core and DynaWeb nodes, you will have to use a node from a package to time the requests. When timing the DynaWeb nodes, start the timer before the WebRequest.Execute node and stop it right after.
time = Web.WebResponse.Time(webResponse=execute, lacing=Shortest)
