# Dynamo graph Dynamo 2.0 - 6 - Complex POST request.dyn

# group: 1. Input
string = StringInput("https://requestb.in/sso5frss")
# note: I suggest using something like RequestBin to test out the package and web responses.
# https://requestb.in/
# Visit the site to generate a fresh URL, this one will likely be out of date.
# Using such a service will allow you to see how different parts of the request would be received by the server.
# I also recommend using the Postman app (https://www.getpostman.com) to figure out how to interact with a REST API first. Once you have it working in Postman, replicating those settings using DynaWeb will be trivial since the nomenclature is pretty much the same.
string_2 = StringInput("""{
  "name": "Dynamo Bot",
  "username": "dynamoBot",
  "email": "mr.robot@dynamobim.org",
  "address": {
    "street": "17 Broadwick St",
    "city": "London",
    "zipcode": "W1F 0DE"
  },
  "phone": "+44-(0)-207-851-8000",
  "website": "dynamobim.org",
  "company": {
    "name": "Autodesk",
    "catchPhrase": "Open source graphical programming for design",
    "bs": "programmind without code"
  }
}""")

# group: DynaWeb : Build & Execute simple request
# note: The "WebRequest.ByURL" node in the DynaWeb Dynamo library builds a web request to the URL provided.
# This node also defaults to building a GET request, but this can be overriden after the request is built using the "WebRequest.SetMethod" node, see the more advanced samples.
# note: The "WebRequest.Execute" node in the DynaWeb Dynamo library simply executes the web request it is given. It expects a valid WebRequest as input.
byUrl = DynaWeb.WebRequest.ByUrl(url=string, lacing=Shortest)

# group: Set HTTP method
# note: The HTTP methods supported by DynaWeb are :
# GET
# POST
# PUT
# DELETE
# HEAD
# OPTIONS
# PATCH
# MERGE
string_3 = StringInput("POST")
setMethod = DynaWeb.WebRequest.SetMethod(webRequest=byUrl, method=string_3, lacing=Shortest)

# group: Add headers
# note: HTTP headers allow the client and the server to pass additional information with the request or the response. A request header consists of its case-insensitive name followed by a colon ':', then by its value (without line breaks). Leading white space before the value is ignored.
# Please see this Mozzila foundation page for more info :
# https://developer.mozilla.org/en-US/docs/Web/HTTP/Headers
code_block = CodeBlock { "customHeader"; "DynaHeader"; }
addHeader = DynaWeb.WebRequest.AddHeader(webRequest=setMethod, name=code_block.out0, value=code_block.out1, lacing=Shortest)

# group: Add cookies
# note: The Cookie is added to the request header and can contain a list of key/value pairs.
# Example : name=value; name2=value2;
# Cookies are usually set by the server during a first interaction and the client/requester then uses that cookie to enable the server to identify it in subsequent requests.
# This field is totally optional.
code_block_2 = CodeBlock { "customCookie"; "DynaCookie"; }
addCookie = DynaWeb.WebRequest.AddCookie(webRequest=addHeader, name=code_block_2.out0, value=code_block_2.out1, lacing=Shortest)

# group: Adding a parameter to URL
code_block_3 = CodeBlock { "queryParam"; "123"; }
addQueryParameter = DynaWeb.WebRequest.AddQueryParameter(webRequest=addCookie, name=code_block_3.out0, value=code_block_3.out1, lacing=Shortest)

# group: Adding a parameter to the body of the request
string_4 = StringInput("undefined")
watch = Watch(string_2)
string_5 = StringInput("RequestBody")
addParameter = DynaWeb.WebRequest.AddParameter(webRequest=addQueryParameter, name=string_4, value=watch, parameterType=string_5, lacing=Shortest)

# group: Tell the server we're sending JSON data
string_6 = StringInput("Content-Type")
# note: Most REST API services will not only return this header, but also require it.
string_7 = StringInput("application/json")
addHeader_2 = DynaWeb.WebRequest.AddHeader(webRequest=addParameter, name=string_6, value=string_7, lacing=Shortest)

# group: Execute the request
execute = DynaWeb.WebRequest.Execute(request=addHeader_2, lacing=Shortest)

# group: Response
# note: The Execute node from the DynaWeb package returns a WebResponse object. This object contains all the metadata of the response as well as the content itself.
# The WebResponse.Content node returns the actual content returned from the server.
# In this example, the server does not return HTML to us, but a simple ok.
# Please see the following image in the samples folder to get a sense of what the server will be receiving when this request is executed :
# 6 - Complex POST request server-side.PNG
content = DynaWeb.WebResponse.Content(webResponse=execute, lacing=Shortest)
watch_2 = Watch(content)

# group: Response metadata
content_2 = DynaWeb.WebResponse.Content(webResponse=execute, lacing=Shortest)
watch_3 = Watch(content_2)
statusCode = DynaWeb.WebResponse.StatusCode(webResponse=execute, lacing=Shortest)
statusDescription = DynaWeb.WebResponse.StatusDescription(webResponse=execute, lacing=Shortest)
responseUri = DynaWeb.WebResponse.ResponseUri(webResponse=execute, lacing=Shortest)
server = DynaWeb.WebResponse.Server(webResponse=execute, lacing=Shortest)
responseStatus = DynaWeb.WebResponse.ResponseStatus(webResponse=execute, lacing=Shortest)
headers = DynaWeb.WebResponse.Headers(webResponse=execute, lacing=Shortest)
watch_4 = Watch(headers)
cookies = DynaWeb.WebResponse.Cookies(webResponse=execute, lacing=Shortest)
watch_5 = Watch(cookies)

# group: Time it took for Request to execute
time = DynaWeb.WebResponse.Time(webResponse=execute, lacing=Shortest)
