# Dynamo graph Dynamo 1.3 - 5 - REST API advanced.dyn (Dynamo 1.3.1.1736)

# group: Format the request
# note: We build the request to the format we require in a series of steps. Each "Set" or "Add" action node for WebRequests returns that modified request, so daisy-chaining them is easy.
# For programmers, these methods overload.
# note: We only execute the request once we have finished formatting it.

# group: Input
# note: This sample is a practical example of interacting with a REST endpoint.
# It's also a great example of how all this functionality could be wrapped into a custom node, as part of a more complete package providing integration with a specific web service.
# The inputs of this graph would map to custom node inputs, as would the deserialised outputs.
string = StringInput("https://jsonplaceholder.typicode.com")
string_2 = StringInput("users")
string_3 = StringInput("""{
  "data": {
    "name": "Dynamo Bot",
    "username": "dynamoBot",
    "email": "mr.robot@dynamobim.org",
    "address": {
      "street": "17 Broadwick St",
      "suite": "17",
      "city": "London",
      "zipcode": "W1F 0DE",
      "geo": {
        "lat": "51.51352559",
        "lng": "-0.135276"
      }
    },
    "phone": "+44-(0)-207-851-8000",
    "website": "dynamobim.org",
    "company": {
      "name": "Autodesk",
      "catchPhrase": "Open source graphical programming for design",
      "bs": "programmind without code"
    }
  }
}""")

# group: Build WebClient & WebRequest for use with client
webClient = Web.WebClient.WebClient(string)
byEndpoint = Web.WebRequest.ByEndpoint(string_2)

# group: Set the request method to POST
# note: Sending a POST request to the "users" endpoint is REST convention for :
# - we are creating a new object
# - that is part of the USERS collection
# Each REST API will obviously have its own conventions, but this is the general approach taken by REST services.
# Notice that POST requests do not specify the ID of the resource like the GET request in previous examples.
# GET    users/1
# POST  users/
# This is because the server is generally responsible for allocating a unique ID to the newly-created resource.
# If we wanted to delete or modify the resource, we would use the DELETE and PUT methods respectively, which would require the ID specified :
# DELETE users/1
# PUT      users/1
string_4 = StringInput("POST")
setMethod = Web.WebRequest.SetMethod(byEndpoint, string_4)

# group: Add the JSON object to the body of the request
# note: Most REST API services will not only return this header, but also require it.
# In this example, we're submitting a relatively complex JSON object. In most practical scenarios, you would either construct the JSON using a from a list of key/value pairs, or by serialising an existing object.
string_5 = StringInput("undefined")
watch = Watch(string_3)
string_6 = StringInput("RequestBody")
addParameter = Web.WebRequest.AddParameter(setMethod, string_5, watch, string_6)

# group: Tell the server we're sending JSON data
string_7 = StringInput("Content-Type")
# note: Most REST API services will not only return this header, but also require it.
string_8 = StringInput("pplication/json")
addHeader = Web.WebRequest.AddHeader(addParameter, string_7, string_8)

# group: Execute request on WebClient
execute = Web.WebClient.Execute(webClient, addHeader)

# group: Response
# note: In this example, we're telling the server to create a
# a single "user".
# The JsonPlaceholder service only has 10 users in its database and will always return an ID of 11 for a good POST request, but the user will not actually be saved to the dabase.
content = Web.WebResponse.Content(execute)
watch_2 = Watch(content)

# group: Deserialise
deserialiseAsDictionary = Web.Helpers.DeserialiseAsDictionary(watch_2)
# note: These 2 outputs would serve great as outputs for a custom node.
watch_properties = Watch(deserialiseAsDictionary)
# note: In this example, we're using 2 deserialisation methods, for 2 distinct purposes :
# Deserialise
# - this gets us the native values returned by the server
# DeserialiseAsDictionary
# - this gets us the names of the properties
# Doing this highlights that this particular endpoint on this server is returning data in the same format we POSTed it in, instead of the regular format used by its /users endpoint.
deserialise = Web.Helpers.Deserialise(watch_2)
watch_values = Watch(deserialise)

# group: time it took to execute the request
time = Web.WebResponse.Time(execute)
