# Dynamo graph Dynamo 1.3 - 8 - Forge request token.dyn (Dynamo 1.3.1.1736)

# group: 1. Input
string = StringInput("https://developer.api.autodesk.com/authentication/v1/authenticate")

# group: build request
byUrl = DynaWeb.WebRequest.ByUrl(string)

# group: Set POST method
string_2 = StringInput("POST")
setMethod = DynaWeb.WebRequest.SetMethod(byUrl, string_2)

# group: Add client ID
code_block = CodeBlock { "client_id"; "xxxxx"; }
string_3 = StringInput("GetOrPost")
addParameter = DynaWeb.WebRequest.AddParameter(setMethod, code_block.out0, code_block.out1, string_3)

# group: Add client secret
code_block_2 = CodeBlock { "client_secret"; "xxxxx"; }
string_4 = StringInput("GetOrPost")
addParameter_2 = DynaWeb.WebRequest.AddParameter(addParameter, code_block_2.out0, code_block_2.out1, string_4)

# group: add grant type
code_block_3 = CodeBlock { "grant_type"; "client_credentials"; }
string_5 = StringInput("GetOrPost")
addParameter_3 = DynaWeb.WebRequest.AddParameter(addParameter_2, code_block_3.out0, code_block_3.out1, string_5)

# group: add token scope
code_block_4 = CodeBlock { "scope"; "data:write"; }
string_6 = StringInput("GetOrPost")
addParameter_4 = DynaWeb.WebRequest.AddParameter(addParameter_3, code_block_4.out0, code_block_4.out1, string_6)

# group: Execute the request
execute = DynaWeb.WebRequest.Execute(addParameter_4)

# group: Response
content = DynaWeb.WebResponse.Content(execute)

# group: Deserialised data
deserialiseAsDictionary = DynaWeb.Helpers.DeserialiseAsDictionary(content)
watch = Watch(deserialiseAsDictionary.out0)
watch_2 = Watch(deserialiseAsDictionary.out1)

# group: Response metadata
content_2 = DynaWeb.WebResponse.Content(execute)
watch_3 = Watch(content_2)
statusCode = DynaWeb.WebResponse.StatusCode(execute)
statusDescription = DynaWeb.WebResponse.StatusDescription(execute)
responseUri = DynaWeb.WebResponse.ResponseUri(execute)
server = DynaWeb.WebResponse.Server(execute)
responseStatus = DynaWeb.WebResponse.ResponseStatus(execute)
headers = DynaWeb.WebResponse.Headers(execute)
watch_4 = Watch(headers)
cookies = DynaWeb.WebResponse.Cookies(execute)
watch_5 = Watch(cookies)

# group: Time it took for Request to execute
time = DynaWeb.WebResponse.Time(execute)

# note: Check this says POST.
method = DynaWeb.WebRequest.Method(setMethod)
