# Dynamo graph Dynamo 1.3 - REST API example.dyn (Dynamo 1.3.1.1736)

# group: Input
string = StringInput("https://jsonplaceholder.typicode.com/users")
string_2 = StringInput("https://jsonplaceholder.typicode.com")
# note: The "users/1" endpoint is REST convention for
# - GET me the resource
# - that is part of USERS
# - and has ID=1
# Each REST API will obviously have its own specs, but this is the general approach taken by REST services.
string_3 = StringInput("users/1")
string_4 = StringInput("posts")
# note: TIP : change the resource for the client-based request to see the results update without having to mess with URLs.
# This also affects the deserialisation at the end, so watch out for the consequences there.
# Currently, the node can only deserialise a single resource, not an array.
# Also play with the resource ID to retrieve specific elements.
string_5 = StringInput("comments")
string_6 = StringInput("posts/3")

# group: Build & Execute simple request
webRequest = Web.WebRequest.WebRequest(string)
execute = Web.WebRequest.Execute(webRequest)

# group: Response
content = Web.WebResponse.Content(execute)
watch = Watch(content)

# group: Build WebClient
webClient = Web.WebClient.WebClient(string_2)

# group: Build WebRequest
webRequest_2 = Web.WebRequest.WebRequest(string_2)
setResource = Web.WebRequest.SetResource(webRequest_2, string_3)

# group: Debug : the URL the client calls
buildUri = Web.WebClient.BuildUri(webClient, setResource)
watch_2 = Watch(buildUri)

# group: time it took to execute the request
time = Web.WebRequest.Time(webRequest)

# group: time it took to execute the request
time_2 = Web.WebRequest.Time(setResource)

# group: Execute request on WebClient
execute_2 = Web.WebClient.Execute(webClient, setResource)

# group: Response
content_2 = Web.WebResponse.Content(execute_2)
watch_3 = Watch(content_2)

# group: Deserialise JSON to dictionary
deserialiseAsDictionary = Web.Helpers.DeserialiseAsDictionary(watch_3)
watch_properties = Watch(deserialiseAsDictionary.out0)
watch_values = Watch(deserialiseAsDictionary.out1)
# note: Values can continue to be deserialised, such as the address in this example.
code_block = CodeBlock(a=deserialiseAsDictionary.out1) { a[4]; }
deserialiseAsDictionary_2 = Web.Helpers.DeserialiseAsDictionary(code_block)
# note: And then deserialising the lat/long further.
code_block_2 = CodeBlock(a=deserialiseAsDictionary_2.out1) { a[4]; }
deserialiseAsDictionary_3 = Web.Helpers.DeserialiseAsDictionary(code_block_2)

string_7 = StringInput("users")

# group: Rebase the JSON on a specific node.
# note: What this does is effectively ignore anything that came before the "address" node, as well as anything that comes after and is not a direct child of this node.
string_8 = StringInput("$.address")
selectJsonRoot = Web.Helpers.SelectJsonRoot(watch_3, string_8)

# group: Deserialise address
deserialiseAsDictionary_4 = Web.Helpers.DeserialiseAsDictionary(selectJsonRoot)
watch_values_2 = Watch(deserialiseAsDictionary_4.out1)
watch_properties_2 = Watch(deserialiseAsDictionary_4.out0)

# group: Deserialise
# note: The Deserialise method is recursive, so it affects all levels of the JSON string, making it much more effective than deserialising to dictionary as below.
# However, you only ever get the values using this method, whereas certain workflows might also require the name of properties, not just the values.
# A good example of this is deserialising the address, as seen below, where both the label ("street", "city" etc) and the value ("Kulas Light" etc) would be useful when saving to Excel or generally using in formatted outputs.
deserialise = Web.Helpers.Deserialise(watch_3)
watch_values_3 = Watch(deserialise)
