# Dynamo graph Dynamo 2.0 - 1 - First request.dyn

# group: 1. Input
# note: All web requests start with a web address, also known as a URL.
# This is what you typically type into the address bar of your web browser.
string = StringInput("http://www.google.com/")

# group: 2. DynaWeb : Build & Execute simple request
# note: The "WebRequest.ByURL" node in the DynaWeb Dynamo library builds a web request to the URL provided.
byUrl = DynaWeb.WebRequest.ByUrl(url=string, lacing=Shortest)
# note: The "WebRequest.Execute" node in the DynaWeb Dynamo library simply executes the web request it is given. It returns a WebResponse object.
execute = DynaWeb.WebRequest.Execute(request=byUrl, lacing=Shortest)

# group: 3. Response
# note: The WebResponse.Content node returns the actual content returned from the server.
# In this example, it's the HTML content returned by the Google.com address. A brower would take this HTML markup and represent it graphically as a webpage.
content = DynaWeb.WebResponse.Content(webResponse=execute, lacing=Shortest)
watch = Watch(content)
