# Dynamo graph Dynamo 2.0 - 7 - Upload file to Autodesk Forge.dyn

# group: Upload file to Autodesk Forge
# note: This sample uploads a file to an existing Autodesk Forge bucket.

# group: INPUT
bucket_key_here = StringInput("radubucket")
# note: Note : the bucket has to exist already.
file_name_here = StringInput("pingfile.txt")
token_here_without_bearer = StringInput("xxxxxxxxxxxxxxxxxxxxxxxxxxxxxxxxxxxxxxxxxxxxxxxxxxxxxxxxxxxxxxxxxxxxxxxxxxxxxxxxxxxxxxxxxxxxxxxxxxxxxxxxxxxxxxxxxxxxxxxxxxxxxxxxxxxxxxxxxxxxxxxxxxxxxxxxxxxxxxxxxxxxxxxxxxxxxxxxxxxxxxxxxxxxxxxxxxxxxxxxxxxxxxxxxxxxxxxxxxxxxxxxxxxxxxxxxxxxxxxxxxxxxxxxxxxxxxxxxxxxxxxxxxxxxxxxxxxxxxxxxxxxxxxxxxxxxxxxxxxxxxxxxxxxxxxxxxxxxxxxxxxxxxxxxxxxxxxxxx")
# note: Notes :
# - replace with your own token
# - token requires the "data:write" scope
file_path = Filename("C:\Users\radug\Desktop\ping.txt")

# group: Build URL
string = StringInput("https://developer.api.autodesk.com/oss/v2/buckets/")
string_2 = StringInput("/objects/")
code_block = CodeBlock(urlbase=string, bucketname=bucket_key_here, object=string_2, filename=file_name_here)
# ---------- code_block.designscript (4 lines) ----------
urlbase+
bucketname+
object+
filename;
# ----------------------------------------

# group: Build POST Request
byUrl = DynaWeb.WebRequest.ByUrl(url=code_block, lacing=Shortest)
string_3 = StringInput("PUT")
setMethod = DynaWeb.WebRequest.SetMethod(webRequest=byUrl, method=string_3, lacing=Shortest)

# group: Auth credentials
string_4 = StringInput("Authorization")
code_block_2 = CodeBlock(tokern=token_here_without_bearer)
# ---------- code_block_2.designscript (2 lines) ----------
"Bearer "+
tokern;
# ----------------------------------------
addHeader = DynaWeb.WebRequest.AddHeader(webRequest=setMethod, name=string_4, value=code_block_2, lacing=Shortest)

# group: Content type
string_5 = StringInput("Content-Type")
string_6 = StringInput("application/octet-stream")
addHeader_2 = DynaWeb.WebRequest.AddHeader(webRequest=addHeader, name=string_5, value=string_6, lacing=Shortest)

# group: Add file
string_7 = StringInput("filename")
code_block_3 = CodeBlock(filepath=file_path) { filepath; }
addFileAsBytes = DynaWeb.WebRequest.AddFileAsBytes(webRequest=addHeader_2, name=string_7, filename=string_7, filepath=code_block_3, lacing=Shortest)

# group: Execute
execute = DynaWeb.WebRequest.Execute(request=addFileAsBytes, lacing=Shortest)
statusCode = DynaWeb.WebResponse.StatusCode(webResponse=execute, lacing=Shortest)
content = DynaWeb.WebResponse.Content(webResponse=execute, lacing=Shortest)

# group: Deserialise JSON
deserialiseAsDictionary = DynaWeb.Helpers.DeserialiseAsDictionary(json=content, lacing=Shortest)
watch = Watch(deserialiseAsDictionary.properties)
watch_2 = Watch(deserialiseAsDictionary.values)
