# Dynamo graph Dynamo 2.0 - simple test with benchmark.dyn

# group: Input
# note: I suggest using something like Mocky.io ( http://www.mocky.io/ ) to test out the package and web responses.
# Visit the site to generate a fresh URL, this one will likely be out of date.
string = StringInput("http://www.mocky.io/v2/5185415ba171ea3a00704eed")
string_2 = StringInput("http://www.google.com/")

# group: Build & Execute the request using this test build of the package.
webRequest = Web.WebRequest.WebRequest(url=string_2, lacing=Shortest)
execute = Web.WebRequest.Execute(request=webRequest, lacing=Shortest)

# group: Request metadata
URL = Web.WebRequest.URL(webRequest=webRequest, lacing=Shortest)
time = Web.WebRequest.Time(webRequest=webRequest, lacing=Shortest)

# group: Response metadata
responseUri = Web.WebResponse.ResponseUri(webResponse=execute, lacing=Shortest)
server = Web.WebResponse.Server(webResponse=execute, lacing=Shortest)
statusCode = Web.WebResponse.StatusCode(webResponse=execute, lacing=Shortest)
headers = Web.WebResponse.Headers(webResponse=execute, lacing=Shortest)
watch = Watch(headers)
content = Web.WebResponse.Content(webResponse=execute, lacing=Shortest)

# group: Build paths for log files
directory_path = Directory("C:\Users\radug\Desktop\testing")
code_block = CodeBlock { "DynWWW-response.txt"; "DynamoCoreNode-response.txt"; }
combinePath = File.CombinePath(path0=directory_path, path1=code_block.out0)
combinePath_2 = File.CombinePath(path0=directory_path, path1=code_block.out1)

# group: Response itself
watch_2 = Watch(content)

# group: Execute the request using built-in node
# note: The only Dynamo node for web interaction in the core.
web_request = WebRequest(url=string_2)

# group: Response itself, no metadata available
watch_3 = Watch(web_request)

# group: Write to log files
writeText = File.WriteText(filePath=combinePath, text=watch_2)
writeText_2 = File.WriteText(filePath=combinePath_2, text=watch_3)
